% Simulink data dictionary Cornex_Config.sldd

CornexMdlCfg = Simulink.ConfigSet(StartTime="0", StopTime="inf", FixedStep="0.01", Solver="FixedStepDiscrete", ProdHWDeviceType="Infineon->TriCore", SystemTargetFile="ert.tlc", TargetLang="C")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

CAN_FD_MESSAGE_BUS = Simulink.Bus(DataScope="Exported")
  ProtocolMode: uint8
  Extended: uint8
  Length: uint8
  Remote: uint8
  Error: uint8
  BRS: uint8
  ESI: uint8
  DLC: uint8
  ID: uint32
  Reserved: uint32
  Timestamp: double
  Data: uint8[64]

SwS_PduInfoType = Simulink.Bus(DataScope="Exported")
  DataPtr: uint8
  Length: uint8

swsEEPRAM_ret = enum(DataScope="Exported", HeaderFile="mem_swscoem.h", DefaultValue="SWS_EEP_RAM_I_SUCCEEDED")
  SWS_EEP_RAM_I_SUCCEEDED = 10
  SWS_EEP_RAM_E_WRG_PARAM = 20
  SWS_EEP_WRITERAM_E_SWOFF_ACTIVE = 30
  SWS_EEP_RAM_ABORTED = 40